# Grasshopper definition GH_Pastas.gh (Grasshopper 1.0.7)
# plug-ins: Pufferfish

number_slider = Slider(28, range=0..100)
addition = Addition(A=25, B=number_slider)
addition_2 = Addition(A=25, B=addition)
addition_3 = Addition(A=25, B=addition)
number_slider_2 = Slider(12, range=4..16)
pt = Point(Point(0, 0, 35))
pt_2 = Point(Point(0, 0, 35))
pt_3 = Point(Point(0, 0, 35))
pt_4 = Point(Point(0, 0, 20))
pt_5 = Point(Point(0, 0, 25))
cir = Circle(Plane=pt_4, Radius=addition)
cir_2 = Circle(Plane=pt_5, Radius=addition_3)
cir_3 = Circle(Plane=pt, Radius=addition_2)
cir_4 = Circle(Plane=pt_2, Radius=addition)
cir_5 = Circle(Plane=pt_3, Radius=number_slider)
loft = Loft(
    Curves=[cir, cir_2, cir_3],
    Options={Adjust=False, Closed=False, LoftEnds=0, LoftSimp=0, LoftType=1, Rebuild=10, Refit=0.01})
srf = Surface(cir)
divide = DivideCurve(Curve=cir_3, Count=number_slider_2, Kinks=False)  # -> Points, Tangents, Parameters
divide_2 = DivideCurve(Curve=cir_4, Count=number_slider_2, Kinks=False)  # -> Points, Tangents, Parameters
divide_3 = DivideCurve(Curve=cir_5, Count=number_slider_2, Kinks=False)  # -> Points, Tangents, Parameters
join = BrepJoin(Breps=[srf, loft])  # -> Breps, Closed
shift = ShiftList(List=divide_2.Points, Shift=Slider(-1, range=-1..1), Wrap=True)
shift_2 = ShiftList(List=divide_2.Points, Shift=1, Wrap=True)
pt_6 = Point(shift_2)
shift_3 = ShiftList(List=pt_6, Shift=-1, Wrap=True)
project = ProjectPoint(Point=shift_3, Direction=Vector(0, 0, -1), Geometry=srf)  # -> Point, Index
shift_4 = ShiftList(List=project.Point, Shift=-1, Wrap=True)
ln = Line(StartPoint=shift_2, EndPoint=divide_3.Points)
ln_2 = Line(StartPoint=shift, EndPoint=divide_3.Points)
pt_7 = Point(Point(0, 0, -7))
ext = ExtendCurve(Curve=ln, Type=Slider(0, range=0..100), Start=Slider(6, range=0..10), End=Slider(0, range=0..10))
ext_2 = ExtendCurve(Curve=ln_2, Type=Slider(0, range=0..100), Start=Slider(6, range=0..10), End=Slider(0, range=0..10))
end = EndPoints(Curve=ext_2)  # -> Start, End
end_2 = EndPoints(Curve=ext)  # -> Start, End
pt_8 = Point(end_2.End)
shift_5 = ShiftList(List=pt_8, Shift=-1, Wrap=True)
project_2 = ProjectPoint(Point=shift_5, Direction=Vector(0, 0, -1), Geometry=srf)  # -> Point, Index
shift_6 = ShiftList(List=project_2.Point, Shift=1, Wrap=True)
ln_3 = Line(StartPoint=shift_6, EndPoint=shift_4)
ln_4 = Line(StartPoint=project_2.Point, EndPoint=project.Point)
python = GhPythonScript(L1=ln_4, L2=ln_3)  # -> out, a, p; inputs L1: list, L2: list
# ---------- python: Python ----------
__author__ = "Nevo"
__version__ = "2020.07.11"

import rhinoscriptsyntax as rs

intersections = [];
for i in range(len(L1)):
    intersections.append(rs.CurveCurveIntersection(L1[i], L2[i])[0][1]);
a = intersections;
p = a[-2];
#print(a[0][1]);
# ---------- end python ----------
shift_7 = ShiftList(List=python.a, Shift=1, Wrap=True)
pt_9 = Point(python.a)
pt_10 = Point(shift_7)
ln_5 = Line(StartPoint=pt_10, EndPoint=pt_9)
project_3 = ProjectPoint(Point=end_2.End, Direction=Vector(0, 0, -0.1), Geometry=srf)  # -> Point, Index
crvmidpt = CurveMiddlePoint(Curve=ln_5, EvaluationType=False)  # -> Middle, Tangent, Parameter, Length
python_2 = GhPythonScript(P1=python.a, P2=project_3.Point)  # -> out, crv, P; inputs P1: list, P2: list
# ---------- python_2: Python ----------
__author__ = "Nevo"
__version__ = "2020.07.11"

import rhinoscriptsyntax as rs

points = [];
crv = [];

for i in range(len(P1)):
    points.append(P1[i]);
    points.append(P2[i]);
points.append(P1[0]);

P=points;
crv = rs.AddPolyline(P);
# ---------- end python_2 ----------
end_3 = EndPoints(Curve=ln_4)  # -> Start, End
addition_4 = Addition(A=crvmidpt.Middle, B=pt_7)
crv = Curve(python_2.crv)
pt_11 = Point(end_3.Start)
pt_12 = Point(end_3.End)
pt_13 = Point(addition_4)
pt_14 = Point(python.a)
srf_2 = Surface(crv)
shift_8 = ShiftList(List=pt_12, Shift=-1, Wrap=True)
shift_9 = ShiftList(List=pt_14, Shift=-1, Wrap=True)
shift_10 = ShiftList(List=pt_11, Shift=1, Wrap=True)
shift_11 = ShiftList(List=pt_13, Shift=-1, Wrap=True)
shift_12 = ShiftList(List=pt_13, Shift=-1, Wrap=True)
shift_13 = ShiftList(List=end.Start, Shift=2, Wrap=True)
ln_6 = Line(StartPoint=shift_13, EndPoint=divide.Points)
shift_14 = ShiftList(List=end_2.Start, Shift=-2, Wrap=True)
ln_7 = Line(StartPoint=shift_14, EndPoint=divide.Points)
ln_8 = Line(StartPoint=shift_8, EndPoint=pt_14)
ln_9 = Line(StartPoint=pt_12, EndPoint=pt_13)
line = Line(ln_9)
ln_10 = Line(StartPoint=pt_13, EndPoint=pt_14)
line_2 = Line(ln_10)
ln_11 = Line(StartPoint=pt_14, EndPoint=shift_12)
line_3 = Line(ln_11)
ln_12 = Line(StartPoint=pt_12, EndPoint=pt_14)
ln_13 = Line(StartPoint=shift_10, EndPoint=pt_13)
line_4 = Line(ln_13)
ln_14 = Line(StartPoint=pt_11, EndPoint=shift_9)
ln_15 = Line(StartPoint=pt_11, EndPoint=pt_14)
move = Move(Geometry=crv, Motion=pt_7)  # -> Geometry, Transform
shift_15 = ShiftList(List=ln_7, Shift=1, Wrap=True)
crvmidpt_2 = CurveMiddlePoint(Curve=line_3, EvaluationType=False)  # -> Middle, Tangent, Parameter, Length
end_4 = EndPoints(Curve=line_3)  # -> Start, End
crvmidpt_3 = CurveMiddlePoint(Curve=line, EvaluationType=False)  # -> Middle, Tangent, Parameter, Length
end_5 = EndPoints(Curve=line)  # -> Start, End
crvmidpt_4 = CurveMiddlePoint(Curve=line_2, EvaluationType=False)  # -> Middle, Tangent, Parameter, Length
end_6 = EndPoints(Curve=line_2)  # -> Start, End
end_7 = EndPoints(Curve=line_3)  # -> Start, End
crvmidpt_5 = CurveMiddlePoint(Curve=ln_9, EvaluationType=False)  # -> Middle, Tangent, Parameter, Length
ln_16 = Line(StartPoint=crvmidpt_2.Middle, EndPoint=end_4.Start)
ln_17 = Line(StartPoint=crvmidpt_3.Middle, EndPoint=end_5.Start)
ln_18 = Line(StartPoint=crvmidpt_4.Middle, EndPoint=end_6.End)
edgesrf = EdgeSurface(CurveA=ln_8, CurveB=ln_11)
pt_15 = Point(end_7.End)
boundary = BoundarySurfaces(Edges=[ln_13, ln_14, ln_10])
srf4pt = _4PointSurface(CornerA=shift_11, CornerB=pt_11, CornerC=pt_14)
edgesrf_2 = EdgeSurface(CurveA=ln_9, CurveB=ln_12, CurveC=ln_10)
python_3 = GhPythonScript(L1=shift_15, L2=ln_6)  # -> out, a; inputs L1: list, L2: list
# ---------- python_3: Python ----------
__author__ = "Nevo"
__version__ = "2020.07.11"

import rhinoscriptsyntax as rs

intersections = [];
for i in range(len(L1)):
    intersections.append(rs.CurveCurveIntersection(L1[i], L2[i])[0][1]);
a = intersections;

l1 = L1[0];
l2 = L2[0];
print(rs.CurveCurveIntersection(L1[0], L2[0])[0]);
# ---------- end python_3 ----------
sdiff = SolidDifference(BrepsA=join.Breps, BrepsB=srf_2)
end_8 = EndPoints(Curve=ln_7)  # -> Start, End
end_9 = EndPoints(Curve=ln_6)  # -> Start, End
crvmidpt_6 = CurveMiddlePoint(Curve=ln_16, EvaluationType=False)  # -> Middle, Tangent, Parameter, Length
shift_16 = ShiftList(List=pt_15, Shift=1, Wrap=True)
crvmidpt_7 = CurveMiddlePoint(Curve=ln_17, EvaluationType=False)  # -> Middle, Tangent, Parameter, Length
crvmidpt_8 = CurveMiddlePoint(Curve=ln_18, EvaluationType=False)  # -> Middle, Tangent, Parameter, Length
crvmidpt_9 = CurveMiddlePoint(Curve=line_4, EvaluationType=False)  # -> Middle, Tangent, Parameter, Length
shift_17 = ShiftList(List=crvmidpt_6.Middle, Shift=1, Wrap=True)
project_4 = ProjectPoint(Point=python_3.a, Direction=Vector(0, 0, -1), Geometry=join.Breps)  # -> Point, Index
project_5 = ProjectPoint(Point=end_8.Start, Direction=Vector(0, 0, -1), Geometry=join.Breps)  # -> Point, Index
project_6 = ProjectPoint(Point=end_9.Start, Direction=Vector(0, 0, -1), Geometry=join.Breps)  # -> Point, Index
project_7 = ProjectPoint(Point=shift_2, Direction=Vector(0, 0, -1), Geometry=join.Breps)  # -> Point, Index
pt_16 = Point(project_4.Point)
shift_18 = ShiftList(List=pt_16, Shift=1, Wrap=True)
ln_19 = Line(StartPoint=shift_18, EndPoint=pt_16)
crvmidpt_10 = CurveMiddlePoint(Curve=ln_19, EvaluationType=False)  # -> Middle, Tangent, Parameter, Length
srf4pt_2 = _4PointSurface(CornerA=crvmidpt_9.Middle, CornerB=shift_17, CornerC=crvmidpt_7.Middle, CornerD=crvmidpt_8.Middle)
srf4pt_3 = _4PointSurface(CornerA=shift_16, CornerB=shift_17, CornerC=crvmidpt_9.Middle, CornerD=crvmidpt_8.Middle)  # disabled
srf4pt_4 = _4PointSurface(CornerA=shift_17, CornerB=crvmidpt_7.Middle, CornerC=shift_16)  # disabled
srf4pt_5 = _4PointSurface(CornerA=crvmidpt_7.Middle, CornerB=crvmidpt_8.Middle, CornerC=shift_16)  # disabled
pt_17 = Point(project_7.Point)
pt_18 = Point(pt_16)
pt_19 = Point(project_5.Point)
pt_20 = Point(end_8.End)
pt_21 = Point(project_6.Point)
addition_5 = Addition(A=crvmidpt_10.Middle, B=pt_7)
shift_19 = ShiftList(List=pt_18, Shift=1, Wrap=True)
shift_20 = ShiftList(List=pt_18, Shift=-1, Wrap=True)
shift_21 = ShiftList(List=pt_20, Shift=1, Wrap=True)
shift_22 = ShiftList(List=pt_19, Shift=1, Wrap=True)
shift_23 = ShiftList(List=pt_17, Shift=-2, Wrap=True)
shift_24 = ShiftList(List=pt_19, Shift=2, Wrap=True)
ln_20 = Line(StartPoint=pt_18, EndPoint=pt_20)
ln_21 = Line(StartPoint=pt_20, EndPoint=shift_20)
ln_22 = Line(StartPoint=addition_5, EndPoint=pt_21)
line_5 = Line(ln_22)
crvmidpt_11 = CurveMiddlePoint(Curve=line_5, EvaluationType=False)  # -> Middle, Tangent, Parameter, Length
end_10 = EndPoints(Curve=line_5)  # -> Start, End
ln_23 = Line(StartPoint=crvmidpt_11.Middle, EndPoint=end_10.End)
crvmidpt_12 = CurveMiddlePoint(Curve=ln_23, EvaluationType=False)  # -> Middle, Tangent, Parameter, Length
ln_24 = Line(StartPoint=addition_5, EndPoint=pt_17)
line_6 = Line(ln_24)
crvmidpt_13 = CurveMiddlePoint(Curve=line_6, EvaluationType=False)  # -> Middle, Tangent, Parameter, Length
end_11 = EndPoints(Curve=line_6)  # -> Start, End
ln_25 = Line(StartPoint=crvmidpt_13.Middle, EndPoint=end_11.End)
crvmidpt_14 = CurveMiddlePoint(Curve=ln_25, EvaluationType=False)  # -> Middle, Tangent, Parameter, Length
ln_26 = Line(StartPoint=addition_5, EndPoint=shift_24)
line_7 = Line(ln_26)
crvmidpt_15 = CurveMiddlePoint(Curve=line_7, EvaluationType=False)  # -> Middle, Tangent, Parameter, Length
end_12 = EndPoints(Curve=line_7)  # -> Start, End
ln_27 = Line(StartPoint=crvmidpt_15.Middle, EndPoint=end_12.End)
crvmidpt_16 = CurveMiddlePoint(Curve=ln_27, EvaluationType=False)  # -> Middle, Tangent, Parameter, Length
srf4pt_6 = _4PointSurface(CornerA=crvmidpt_14.Middle, CornerB=crvmidpt_16.Middle, CornerC=crvmidpt_12.Middle)
ln_28 = Line(StartPoint=addition_5, EndPoint=shift_21)
line_8 = Line(ln_28)
crvmidpt_17 = CurveMiddlePoint(Curve=line_8, EvaluationType=False)  # -> Middle, Tangent, Parameter, Length
end_13 = EndPoints(Curve=line_8)  # -> Start, End
ln_29 = Line(StartPoint=crvmidpt_17.Middle, EndPoint=end_13.End)
crvmidpt_18 = CurveMiddlePoint(Curve=ln_29, EvaluationType=False)  # -> Middle, Tangent, Parameter, Length
ln_30 = Line(StartPoint=addition_5, EndPoint=shift_19)
line_9 = Line(ln_30)
crvmidpt_19 = CurveMiddlePoint(Curve=line_9, EvaluationType=False)  # -> Middle, Tangent, Parameter, Length
end_14 = EndPoints(Curve=line_9)  # -> Start, End
ln_31 = Line(StartPoint=crvmidpt_19.Middle, EndPoint=end_14.End)
crvmidpt_20 = CurveMiddlePoint(Curve=ln_31, EvaluationType=False)  # -> Middle, Tangent, Parameter, Length
ln_32 = Line(StartPoint=addition_5, EndPoint=pt_18)
line_10 = Line(ln_32)
crvmidpt_21 = CurveMiddlePoint(Curve=line_10, EvaluationType=False)  # -> Middle, Tangent, Parameter, Length
end_15 = EndPoints(Curve=line_10)  # -> Start, End
ln_33 = Line(StartPoint=crvmidpt_21.Middle, EndPoint=end_15.End)
crvmidpt_22 = CurveMiddlePoint(Curve=ln_33, EvaluationType=False)  # -> Middle, Tangent, Parameter, Length
srf4pt_7 = _4PointSurface(CornerA=crvmidpt_22.Middle, CornerB=crvmidpt_20.Middle, CornerC=crvmidpt_18.Middle)
shift_25 = ShiftList(List=ln_20, Shift=1, Wrap=True)
shift_26 = ShiftList(List=ln_21, Shift=1, Wrap=True)
crvmidpt_23 = CurveMiddlePoint(Curve=ln_28, EvaluationType=False)  # -> Middle, Tangent, Parameter, Length
edgesrf_3 = EdgeSurface(CurveA=ln_26, CurveB=ln_24)
edgesrf_4 = EdgeSurface(CurveA=ln_30, CurveB=ln_26)
edgesrf_5 = EdgeSurface(CurveA=ln_30, CurveB=ln_28, CurveC=shift_25)
ln_34 = Line(StartPoint=pt_21, EndPoint=pt_17)
edgesrf_6 = EdgeSurface(CurveA=ln_22, CurveB=ln_24)
ln_35 = Line(StartPoint=shift_22, EndPoint=pt_18)
edgesrf_7 = EdgeSurface(CurveA=ln_32, CurveB=ln_28, CurveC=shift_26)
edgesrf_8 = EdgeSurface(CurveA=ln_32, CurveB=ln_22)
ln_36 = Line(StartPoint=pt_18, EndPoint=pt_21)
ln_37 = Line(StartPoint=shift_23, EndPoint=pt_19)
line_11 = Line(ln_8)
line_12 = Line(ln_12)
crv_2 = Curve([ln_34, ln_36, ln_35, ln_37, line_12, line_11])
crv_3 = Curve([line_11, line_12])
shift_27 = ShiftList(List=ln_37, Shift=1, Wrap=True)
shift_28 = ShiftList(List=ln_20, Shift=1, Wrap=True)
end_16 = EndPoints(Curve=shift_28)  # -> Start, End
circle = Circle(cir_3)
end_17 = EndPoints(Curve=ln_21)  # -> Start, End
ln_38 = Line(StartPoint=end_16.End, EndPoint=end_17.Start)
shift_29 = ShiftList(List=ln_21, Shift=1, Wrap=True)
edgesrf_9 = EdgeSurface(CurveA=line_11, CurveB=line_12)
merge = Merge(Data1=line_11, Data2=line_12, Data3=ln_34, Data4=ln_36, Data5=ln_35, Data6=ln_37)
edgesrf_10 = EdgeSurface(CurveA=ln_36, CurveB=ln_35)
edgesrf_11 = EdgeSurface(CurveA=ln_34, CurveB=shift_27)
srf_3 = Surface([edgesrf_10, edgesrf_9, edgesrf_11])
crv_4 = Curve(crv)
srf_4 = Surface(move.Geometry)
mesh = Mesh([boundary, srf4pt, edgesrf, edgesrf_2])
edgesrf_12 = EdgeSurface(CurveA=ln_38, CurveB=ln_20, CurveC=shift_29)
mesh_2 = Mesh([edgesrf_3, edgesrf_4, edgesrf_5, edgesrf_7, edgesrf_8, edgesrf_6])
extr = Extrude(Base=crv_4, Direction=pt_7)
pipe = Pipe(
    Curve=[ln_32, ln_26, ln_22, ln_30, ln_24, ln_28, ln_20, ln_21, ln_34, ln_36, ln_35, ln_37, ln_13, ln_14, ln_15, ln_8, ln_11, ln_9, ln_12, ln_10, crv, move.Geometry],
    Radius=Slider(0.1, range=0.1..1.1),
    Caps=2)
mesh_3 = Mesh(extr)
mesh_4 = Mesh([mesh_2, mesh, srf_4, edgesrf_12, move.Geometry])
mesh_5 = Mesh(srf_3)
mesh_6 = Mesh([mesh_3, mesh_4, mesh_5, pipe])
num = Number(number_slider)
subtraction = Subtraction(A=0, B=num)
division = Division(A=subtraction, B=subtraction)
division_2 = Division(A=number_slider, B=1.3)
subtraction_2 = Subtraction(A=0, B=Slider(20, range=0..100))
division_3 = Division(A=division_2, B=2)
subtraction_3 = Subtraction(A=0, B=division_3)
xy = XYPlane(Origin=Point(0, 0, 0))
division_4 = Division(A=number_slider_2, B=1.2)
crv_5 = Curve(move.Geometry)
pt_22 = Point(Point(0, 0, 10))
pt_23 = Point(Point(0, 0, 13))
offset = OffsetCurve(Curve=crv_5, Distance=subtraction_2, Plane=xy, Corners=1)
division_5 = Division(A=number_slider_2, B=3)
division_6 = Division(A=number_slider_2, B=2)
explode = Explode(Curve=offset, Recursive=True)  # -> Segments, Vertices
pt_24 = Point(crvmidpt_5.Middle)
pt_25 = Point(crvmidpt_23.Middle)
line_13 = Line(explode.Segments)
thickness = Slider(3, range=0..10)
amount = Slider(10, range=0..10)
python_4 = GhPythonScript(x=amount)  # -> out, a
# ---------- python_4: Python ----------
__author__ = "Nevo"
__version__ = "2020.07.13"

import rhinoscriptsyntax as rs

if x<3:
    a = 2;
elif x<5:
    a = 3;
elif x < 8:
    a = 4;
elif x < 11:
    a = 5;
# ---------- end python_4 ----------
pt_26 = ConstructPoint(XCoordinate=0, YCoordinate=0, ZCoordinate=python_4.a)
thickness_2 = Slider(3, range=0..10)
amount_2 = Slider(2, range=0..10)
thickness_3 = Slider(7, range=0..10)
amount_3 = Slider(4, range=0..10)
pt_27 = ConstructPoint(XCoordinate=thickness, YCoordinate=amount, ZCoordinate=0)
pt_28 = Point(Point(0, 0, 0))
pt_29 = ConstructPoint(XCoordinate=thickness_2, YCoordinate=amount_2, ZCoordinate=0)
pt_30 = ConstructPoint(XCoordinate=thickness_3, YCoordinate=amount_3, ZCoordinate=0)
pt_31 = Point(Point(0, 0, 0))
pt_32 = Point(Point(0, 0, 0))
dist = Distance(PointA=pt_27, PointB=pt_28)
number_slider_3 = Slider(7, range=0..11)
dist_2 = Distance(PointA=pt_29, PointB=pt_31)
dist_3 = Distance(PointA=pt_30, PointB=pt_32)
panel = Panel("Bowl")
panel_2 = Panel("Base")
mesh_7 = Mesh([srf4pt_2, srf4pt_3, srf4pt_4, srf4pt_5])
mesh_8 = Mesh([srf4pt_6, srf4pt_7])
panel_3 = Panel("Pastas")
panel_4 = Panel("Sauces")
panel_5 = Panel("Pastas Selection w/Galapagos")
number_slider_4 = Slider(9, range=0..9)
number_slider_5 = Slider(2, range=0..10)
galapagos = Galapagos(fitness=num_2, gene=number_slider_3)
galapagos_2 = Galapagos(fitness=num_3, gene=number_slider_4)
python_5 = GhPythonScript(x=number_slider_3)  # -> out, chosen; inputs x: Int32
# ---------- python_5: Python ----------
__author__ = "Nevo"
__version__ = "2020.07.12"

import rhinoscriptsyntax as rs

z = rs.AddPoint(0,0);
a = rs.Distance(z, rs.AddPoint(2, 5)); #1
b = rs.Distance(z, rs.AddPoint(3, 6)); #2
c = rs.Distance(z, rs.AddPoint(4, 7)); #3
d = rs.Distance(z, rs.AddPoint(5, 8)); #4
e = rs.Distance(z, rs.AddPoint(7, 9)); #5
f = rs.Distance(z, rs.AddPoint(8, 7)); #6
g = rs.Distance(z, rs.AddPoint(8, 5)); #7
h = rs.Distance(z, rs.AddPoint(8, 3)); #8
i = rs.Distance(z, rs.AddPoint(8, 2)); #9
j = rs.Distance(z, rs.AddPoint(7, 3)); #10
k = rs.Distance(z, rs.AddPoint(6, 4)); #11
l = rs.Distance(z, rs.AddPoint(3, 4)); #12

list = [a, b, c, d, e, f, g, h, i, j, k, l];
chosen = list[x];
# ---------- end python_5 ----------
subtraction_4 = Subtraction(A=dist, B=python_5.chosen)
galapagos_3 = Galapagos(fitness=num_4, gene=number_slider_5)
abs = Absolute(Value=subtraction_4)
num_2 = Number(abs)
python_6 = GhPythonScript(x=number_slider_4, n1=number_slider_5, n2=number_slider_3)  # -> out, chosen; inputs x: Int32
# ---------- python_6: Python ----------
__author__ = "Nevo"
__version__ = "2020.07.12"

import rhinoscriptsyntax as rs

z = rs.AddPoint(0,0);
a = rs.Distance(z, rs.AddPoint(2, 5)); #1
b = rs.Distance(z, rs.AddPoint(3, 6)); #2
c = rs.Distance(z, rs.AddPoint(4, 7)); #3
d = rs.Distance(z, rs.AddPoint(5, 8)); #4
e = rs.Distance(z, rs.AddPoint(7, 9)); #5
f = rs.Distance(z, rs.AddPoint(8, 7)); #6
g = rs.Distance(z, rs.AddPoint(8, 5)); #7
h = rs.Distance(z, rs.AddPoint(8, 3)); #8
i = rs.Distance(z, rs.AddPoint(8, 2)); #9
j = rs.Distance(z, rs.AddPoint(7, 3)); #10
k = rs.Distance(z, rs.AddPoint(6, 4)); #11
l = rs.Distance(z, rs.AddPoint(3, 4)); #12

list = [a, b, c, d, e, f, g, h, i, j, k, l];
list.pop(n1);
list.pop(n2);
chosen = list[x];
# ---------- end python_6 ----------
subtraction_5 = Subtraction(A=dist_2, B=python_6.chosen)
abs_2 = Absolute(Value=subtraction_5)
offmsh = OffsetMesh(Mesh=mesh_6, Distance=1, BothSides=False, CreateSolid=True)
python_7 = GhPythonScript(x=number_slider_5, n=number_slider_3)  # -> out, chosen; inputs x: Int32
# ---------- python_7: Python ----------
__author__ = "Nevo"
__version__ = "2020.07.12"

import rhinoscriptsyntax as rs

z = rs.AddPoint(0,0);
a = rs.Distance(z, rs.AddPoint(2, 5)); #1
b = rs.Distance(z, rs.AddPoint(3, 6)); #2
c = rs.Distance(z, rs.AddPoint(4, 7)); #3
d = rs.Distance(z, rs.AddPoint(5, 8)); #4
e = rs.Distance(z, rs.AddPoint(7, 9)); #5
f = rs.Distance(z, rs.AddPoint(8, 7)); #6
g = rs.Distance(z, rs.AddPoint(8, 5)); #7
h = rs.Distance(z, rs.AddPoint(8, 3)); #8
i = rs.Distance(z, rs.AddPoint(8, 2)); #9
j = rs.Distance(z, rs.AddPoint(7, 3)); #10
k = rs.Distance(z, rs.AddPoint(6, 4)); #11
l = rs.Distance(z, rs.AddPoint(3, 4)); #12

list = [a, b, c, d, e, f, g, h, i, j, k, l];
list.pop(n);
chosen = list[x];
# ---------- end python_7 ----------
subtraction_6 = Subtraction(A=dist_3, B=python_7.chosen)
abs_3 = Absolute(Value=subtraction_6)
srf_5 = Surface(srf_4)
move_2 = Move(Geometry=srf_5, Motion=pt_26)  # -> Geometry, Transform
pcen = PolygonCenter(Polyline=srf_5)  # -> CenterV, CenterE, CenterA
pt_33 = Point(pcen.CenterV)
cir_6 = Circle(Plane=pt_33, Radius=division_2)
cir_7 = Circle(Plane=pt_33, Radius=division_2)
move_3 = Move(Geometry=cir_6, Motion=pt_22)  # -> Geometry, Transform
rot = Rot(crv=cir_7)
move_4 = Move(Geometry=cir_6, Motion=pt_23)  # -> Geometry, Transform
divide_4 = DivideCurve(Curve=cir_6, Count=division_4, Kinks=False)  # -> Points, Tangents, Parameters
divide_5 = DivideCurve(Curve=rot, Count=division_4, Kinks=True)  # -> Points, Tangents, Parameters
offset_2 = OffsetCurve(Curve=move_3.Geometry, Distance=subtraction_3, Plane=PlaneXY(0, 0, 0), Corners=1)
divide_6 = DivideCurve(Curve=offset_2, Count=division_5, Kinks=False)  # -> Points, Tangents, Parameters
offset_3 = OffsetCurve(Curve=move_4.Geometry, Distance=subtraction_3, Plane=PlaneXY(0, 0, 0), Corners=1)
rot_2 = Rot(crv=offset_3)
divide_7 = DivideCurve(Curve=offset_3, Count=division_6, Kinks=False)  # -> Points, Tangents, Parameters
divide_8 = DivideCurve(Curve=rot_2, Count=division_6, Kinks=True)  # -> Points, Tangents, Parameters
move_5 = Move(Geometry=srf_5, Motion=pt_26)  # -> Geometry, Transform
num_3 = Number(abs_2)
num_4 = Number(abs_3)
_2 = Mesh(<mesh referenced from the Rhino model>)
_7 = Mesh(<mesh referenced from the Rhino model>)
_2_2 = Mesh(_7)
pasta2 = Mesh(_2_2)
volume = Volume(Geometry=pasta2)  # -> Volume, Centroid
volume_2 = Volume(Geometry=pasta2)  # -> Volume, Centroid
vec2pt = Vector2Pt(PointA=volume.Centroid, PointB=pt_24, Unitize=False)  # -> Vector, Length
vec2pt_2 = Vector2Pt(PointA=volume_2.Centroid, PointB=divide_8.Points, Unitize=False)  # -> Vector, Length
move_6 = Move(Geometry=pasta2, Motion=vec2pt_2.Vector)  # -> Geometry, Transform
move_7 = Move(Geometry=pasta2, Motion=vec2pt.Vector)  # -> Geometry, Transform
_8 = Mesh(<mesh referenced from the Rhino model>)
_1 = Mesh(<mesh referenced from the Rhino model>)
_1_2 = Mesh(_1)
pasta1 = Mesh(_1_2)
volume_3 = Volume(Geometry=pasta1)  # -> Volume, Centroid
volume_4 = Volume(Geometry=pasta1)  # -> Volume, Centroid
vec2pt_3 = Vector2Pt(PointA=volume_3.Centroid, PointB=divide_4.Points, Unitize=False)  # -> Vector, Length
volume_5 = Volume(Geometry=pasta1)  # -> Volume, Centroid
vec2pt_4 = Vector2Pt(PointA=volume_4.Centroid, PointB=divide_6.Points, Unitize=False)  # -> Vector, Length
vec2pt_5 = Vector2Pt(PointA=volume_5.Centroid, PointB=divide_7.Points, Unitize=False)  # -> Vector, Length
move_8 = Move(Geometry=pasta1, Motion=vec2pt_3.Vector)  # -> Geometry, Transform
move_9 = Move(Geometry=pasta1, Motion=vec2pt_5.Vector)  # -> Geometry, Transform
move_10 = Move(Geometry=pasta1, Motion=vec2pt_4.Vector)  # -> Geometry, Transform
_3 = Mesh(<mesh referenced from the Rhino model>)
_5 = Mesh(<mesh referenced from the Rhino model>)
_6 = Mesh(<mesh referenced from the Rhino model>)
_9 = Mesh(<mesh referenced from the Rhino model>)
_3_2 = Mesh(_9)
pasta3 = Mesh(_3_2)
volume_6 = Volume(Geometry=pasta3)  # -> Volume, Centroid
volume_7 = Volume(Geometry=pasta3)  # -> Volume, Centroid
vec2pt_6 = Vector2Pt(PointA=volume_6.Centroid, PointB=divide_5.Points, Unitize=False)  # -> Vector, Length
vec2pt_7 = Vector2Pt(PointA=volume_7.Centroid, PointB=pt_25, Unitize=False)  # -> Vector, Length
move_11 = Move(Geometry=pasta3, Motion=vec2pt_6.Vector)  # -> Geometry, Transform
move_12 = Move(Geometry=pasta3, Motion=vec2pt_7.Vector)  # -> Geometry, Transform
_10 = Mesh(<mesh referenced from the Rhino model>)
_11 = Mesh(<mesh referenced from the Rhino model>)
_12 = Mesh(<mesh referenced from the Rhino model>)
_4 = Mesh(<mesh referenced from the Rhino model>)
panel_6 = Panel(num_2)
panel_7 = Panel(num_3)
create_material = CreateMaterial(
    Diffuse=ColourSwatch(SwatchColor=RGB(252, 245, 159)),
    Specular=RGB(255, 255, 255),
    Emission=RGB(0, 0, 0),
    Transparency=Slider(0, range=0..1),
    Shine=0)
panel_8 = Panel(num_4)
create_material_2 = CreateMaterial(
    Diffuse=ColourSwatch(SwatchColor=RGB(94, 158, 19)),
    Specular=RGB(255, 255, 255),
    Emission=RGB(0, 0, 0),
    Transparency=Slider(0.134, range=0..1),
    Shine=100)
create_material_3 = CreateMaterial(
    Diffuse=ColourSwatch(SwatchColor=RGBA(136, 1, 0, 180)),
    Specular=RGB(255, 255, 255),
    Emission=RGB(187, 10, 0),
    Transparency=Slider(0.285, range=0..1),
    Shine=60)
create_material_4 = CreateMaterial(
    Diffuse=ColourSwatch(SwatchColor=RGBA(255, 255, 146, 222)),
    Specular=RGB(255, 255, 255),
    Emission=RGB(0, 0, 0),
    Transparency=Slider(0.405, range=0..1),
    Shine=60)
python_8 = GhPythonScript(n=number_slider_3, pastas=[_1, _2, _3, _4, _5, _6, _7, _8, _9, _10, _11, _12])  # -> out, pasta, new_pastas; inputs n: Int32, pastas: list
# ---------- python_8: Python ----------
__author__ = "Nevo"
__version__ = "2020.07.12"

import rhinoscriptsyntax as rs
pasta = pastas[n];
pastas.pop(n);
new_pastas = pastas;
# ---------- end python_8 ----------
python_9 = GhPythonScript(n=number_slider_5, pastas=python_8.new_pastas)  # -> out, pasta, new_pastas; inputs n: Int32, pastas: list of Mesh; same code as python_8
python_10 = GhPythonScript(n=number_slider_4, pastas=python_9.new_pastas)  # -> out, pasta, new_pastas; inputs n: Int32, pastas: list of Mesh; same code as python_8
preview = CustomPreview(
    Geometry=[move_11.Geometry, move_8.Geometry, move_6.Geometry, move_9.Geometry, move_10.Geometry, move_7.Geometry, move_12.Geometry],
    Material=create_material)
preview_2 = CustomPreview(Geometry=move_5.Geometry, Material=create_material_3)
preview_3 = CustomPreview(Geometry=mesh_8, Material=create_material_4)
preview_4 = CustomPreview(Geometry=mesh_7, Material=create_material_2)

# ==== cluster Rot
crv = ClusterInput()
crv_2 = Curve(reparameterize(crv))
pt_on_crv = Point(Point(3.616473674, -8.887779417, -3.86531981))
crv_cp = CurveCP(Point=pt_on_crv, Curve=crv_2)  # -> Point, Parameter, Distance
dom = Domain(DomainStart=0, DomainEnd=crv_cp.Parameter)
dom_2 = Domain(DomainStart=crv_cp.Parameter, DomainEnd=1)
subcrv = SubCurve(BaseCurve=crv_2, Domain=[dom_2, dom])
join = JoinCurves(Curves=subcrv, Preserve=True)
C = ClusterOutput(join)
